# Grasshopper definition machinelearning.gh (Grasshopper 1.0.7)
# plug-ins: BH.UI.Grasshopper

getinfo = GetInfo(Component="{ .GetInfo")
# <Script name>
project_number = Panel("")
setprojectid = SetProjectID(ProjectID=project_number, Component="{ .SetProjectID")
bhom_version_used_to_create = Panel("6.0")
bhom_version_currently_installed = Panel(getinfo)
panel = Panel("""0.37
-0.04
-0.45
1.73
-0.37
-0.92
-1.96
1.04
-0.64
0.21
-0.20""")
path = FilePath("C:\Users\clockhart\Desktop\test.csv")
path_2 = FilePath("C:\Users\clockhart\Desktop\Old_Sketch_Books\")
createtsvfile = CreateTSVfile(FolderPath=path_2, Run=Toggle(False), Component="{ .CreateTSVfile")
buildimagemodel = BuildImageModel(TSVFilePath=createtsvfile, Retrain=Toggle(False), Seed=Slider(999, range=0..1000), Component="{ .BuildImageModel")
numberpatterns = NumberPatterns(CsvFilePath=path, Delimintor=";", InputData=panel, Retrain=False, Component="{ .NumberPatterns")
path_3 = FilePath("C:\Users\clockhart\Desktop\Old_Sketch_Books\Beijing_Grand_Canal_Competition\Bridge_Basketball_Courts.png")
panel_2 = Panel(numberpatterns)
should_be_aroud = Panel("320")
estimateimage = EstimateImage(ImageFilePath=path_3, ModelFilePath=buildimagemodel, Component="{ .EstimateImage")
panel_3 = Panel(estimateimage)
